# Dynamo graph RoomTagBrailleConverter1.0.0.dyn (Dynamo 2.19.3.6394)

# group: Inputs
family_directory_path = Directory("C:\Users\Computer User\OneDrive\Desktop\New folder")  # graph input
run_all_levels = BoolSelector(true)  # graph input
individual_level = Levels("L3")  # graph input

# group: Create Braille Families
python_script = Python(IN[0]=family_directory_path, IN[1]=run_all_levels, IN[2]=individual_level)  # CPython3
# ---------- python_script.python (215 lines) ----------
import clr
import os

clr.AddReference('RevitAPI')
from Autodesk.Revit.DB import *
from Autodesk.Revit.DB.Structure import *

clr.AddReference('RevitNodes')
import Revit
clr.ImportExtensions(Revit.GeometryConversion)
clr.ImportExtensions(Revit.Elements)

clr.AddReference('RevitServices')
import RevitServices
from RevitServices.Persistence import DocumentManager
from RevitServices.Transactions import TransactionManager

doc = DocumentManager.Instance.CurrentDBDocument


############  BRAILLE DICTIONARIES  ############  
# Braille Unicode dictionary
braille_unicode = {
    'a': '⠁', 'b': '⠃', 'c': '⠉', 'd': '⠙', 'e': '⠑', 'f': '⠋', 'g': '⠛',
    'h': '⠓', 'i': '⠊', 'j': '⠚', 'k': '⠅', 'l': '⠇', 'm': '⠍', 'n': '⠝',
    'o': '⠕', 'p': '⠏', 'q': '⠟', 'r': '⠗', 's': '⠎', 't': '⠞', 'u': '⠥',
    'v': '⠧', 'w': '⠺', 'x': '⠭', 'y': '⠽', 'z': '⠵',
    '1': '⠁', '2': '⠃', '3': '⠉', '4': '⠙', '5': '⠑', '6': '⠋', '7': '⠛',
    '8': '⠓', '9': '⠊', '0': '⠚', ' ': ' ', '#': '⠼'
}

# Braille map including number sign
brailleMap = {
    'a': [1], 'b': [1, 2], 'c': [1, 4], 'd': [1, 4, 5], 'e': [1, 5], 'f': [1, 2, 4],
    'g': [1, 2, 4, 5], 'h': [1, 2, 5], 'i': [2, 4], 'j': [2, 4, 5], 'k': [1, 3],
    'l': [1, 2, 3], 'm': [1, 3, 4], 'n': [1, 3, 4, 5], 'o': [1, 3, 5], 'p': [1, 2, 3, 4],
    'q': [1, 2, 3, 4, 5], 'r': [1, 2, 3, 5], 's': [2, 3, 4], 't': [2, 3, 4, 5],
    'u': [1, 3, 6], 'v': [1, 2, 3, 6], 'w': [2, 4, 5, 6], 'x': [1, 3, 4, 6],
    'y': [1, 3, 4, 5, 6], 'z': [1, 3, 5, 6],
    '1': [1], '2': [1, 2], '3': [1, 4], '4': [1, 4, 5], '5': [1, 5], '6': [1, 2, 4],
    '7': [1, 2, 4, 5], '8': [1, 2, 5], '9': [2, 4], '0': [2, 4, 5],
    '#': [3, 4, 5, 6]
}

############  FUNCTIONS  ############  

def wordLength(word , heightFactor , letterSpacing):
    totalWordLength = 0
    for letter in word:    
        if letter.isdigit():
            totalWordLength += 2 * heightFactor + letterSpacing
        totalWordLength += 2 * heightFactor + letterSpacing
    return totalWordLength

def processRoom(room):
    name = r.get_Parameter(BuiltInParameter.ROOM_NAME).AsString()
    num = r.get_Parameter(BuiltInParameter.ROOM_NUMBER).AsString()
    roomLocation = r.Location.Point
    lvl = r.Level               
    totalLengthName  = wordLength(name, heightFactor , letterSpacing)
    totalLengthNum = wordLength(num, heightFactor , letterSpacing) 
    
    basePoint = XYZ(0,0,0)
    
    nameLocPt = XYZ(basePoint.X - totalLengthName / 2, basePoint.Y, basePoint.Z)
    numLocPt = XYZ(basePoint.X - totalLengthNum / 2, basePoint.Y - (4 * heightFactor  + letterSpacing), basePoint.Z)    


    return [name , num , roomLocation, lvl , totalLengthName, totalLengthNum,nameLocPt,numLocPt]        

def getFamByName(doc,familyName ):
    collector = FilteredElementCollector(doc).OfClass(Family)
    for family in collector:
        if family.Name == familyName:
            return family
    return None

def generateBrailleCellPoints(scaleFactor):
    cellWidth = 2
    cellHeight = 3
    brailleCellPoints = []
    dotOrder = [(0, 2), (0, 1), (0, 0), (1, 2), (1, 1), (1, 0)]

    for i, (col, row) in enumerate(dotOrder):
        x = col * scaleFactor
        y = row * scaleFactor
        point = XYZ(x, y, 0)
        position = i + 1
        brailleCellPoints.append((point.ToPoint(), position))

    return brailleCellPoints

def getBraillePointsForLetter(letter, scaleFactor):
    brailleCellPoints = generateBrailleCellPoints(scaleFactor)
    dotConfiguration = brailleMap.get(letter.lower(), [])
    braillePoints = [brailleCellPoints[dot - 1] for dot in dotConfiguration]
    return braillePoints
    

def createOffsetPoints(doc, letter, heightFactor, basePoint, fam,currentOffset):
    allBraillePoints , newFams = [] , []
    
    letterPoints = getBraillePointsForLetter(letter, heightFactor)
    offsetLetterPoints = []
    for point, pos in letterPoints:
        offsetPoint = XYZ(point.X + currentOffset + basePoint.X, point.Y + basePoint.Y, point.Z + basePoint.Z)
        offsetLetterPoints.append(offsetPoint)
    
    for offsetPoint in offsetLetterPoints:
        newFam = doc.FamilyCreate.NewFamilyInstance(offsetPoint, fam, StructuralType.NonStructural)
        newFams.append(newFam)
        allBraillePoints.append(offsetPoint.ToPoint())

    return newFams   

def processFamily (doc , rmLoc , rmName , rmNum, namLoc , numLoc):  
    brailleFams = []
    brailleTempFamily = getFamByName(doc,"Braille Template Family" )
    TransactionManager.Instance.ForceCloseTransaction()
    familyDoc = doc.EditFamily(brailleTempFamily)

    TransactionManager.Instance.EnsureInTransaction(familyDoc)

## GET BRAILLE DOT FAMILY ##
    brailleDotFam = getFamByName(familyDoc, "Braille Dot")
    symIds = brailleDotFam.GetFamilySymbolIds()
    for s in symIds:
        dotSymbol = familyDoc.GetElement(s)
        break
    dotSymbol.Activate()   

 ## GET POINTS AND CREATE DOT FAMILIES ##   
    currentOffset = 0
    for letter in rmName:
        if letter.isdigit():
            newFams = createOffsetPoints(familyDoc, "#", heightFactor, namLoc, dotSymbol,currentOffset)        
            currentOffset += 2 * heightFactor+ letterSpacing
            brailleFams.append(newFams)
        newFams = createOffsetPoints(familyDoc, letter, heightFactor, namLoc, dotSymbol,currentOffset)  
        currentOffset += 2 * heightFactor+ letterSpacing
        brailleFams.append(newFams)
    currentOffset = 0    
    for letter in rmNum:
        if letter.isdigit():
            newFams = createOffsetPoints(familyDoc, "#", heightFactor, numLoc, dotSymbol,currentOffset)        
            currentOffset += 2 * heightFactor+ letterSpacing
            brailleFams.append(newFams)
        newFams = createOffsetPoints(familyDoc, letter, heightFactor, numLoc, dotSymbol,currentOffset)  
        currentOffset += 2 * heightFactor+ letterSpacing
        brailleFams.append(newFams)      
  
 ## GET FILE PATH AND FILE NAME ##
    
    fileName = rmName + "_" + rmNum 
    familyFileName = f"{fileName}.rfa"
    familyPath = os.path.join(directoryPath, familyFileName) 
    TransactionManager.Instance.ForceCloseTransaction()
    #TransactionManager.Instance.TransactionTaskDone() 
    saveOptions = SaveAsOptions()
    saveOptions.OverwriteExistingFile = True
    familyDoc.SaveAs(familyPath, saveOptions)
    #familyDoc.Close(True)    
    
    TransactionManager.Instance.EnsureInTransaction(doc)
    familyLoaded = doc.LoadFamily(familyPath)

    doc.Regenerate()
    TransactionManager.Instance.TransactionTaskDone() 

 ## PLACE FAMILY ##      

    loadedFamily = getFamByName(doc,fileName)  
    for familySymbolId in loadedFamily.GetFamilySymbolIds():
        loadedFamilySymbol = doc.GetElement(familySymbolId)
        break
    TransactionManager.Instance.EnsureInTransaction(doc)
    loadedFamilySymbol.Activate()
    newInstance = doc.Create.NewFamilyInstance(rmLoc, loadedFamilySymbol, StructuralType.NonStructural)
    TransactionManager.Instance.ForceCloseTransaction()
    
    #familyDoc.Close(False)    
    
    return brailleFams

############  INPUTS  ############  
directoryPath = IN[0] # Directory path to save the modified family
allLevels = IN[1]
level = UnwrapElement(IN[2])

############  HARDCODED INPUTS  ############  
#These could become inputs if desired
heightFactor = 0.250
letterSpacing = 0.125

############  LOOP THROUGH PROJECT ROOMS  ############  
rooms = FilteredElementCollector(doc).OfCategory(BuiltInCategory.OST_Rooms).WhereElementIsNotElementType().ToElements()

roomInfo = []
for r in rooms:
    if r.Area >0:    
        if allLevels:
            roomInfo.append(processRoom(r))      
        else:
            if r.Level.Id == level.Id:
                roomInfo.append(processRoom(r))

############  PROCESS ROOM LIST TO CREATE BRAILLE FAMILY ############  
brailleFams = []
errors = []
for room in roomInfo:
    try:
        brailleFams.append(processFamily(doc , room[2] , room[0], room[1],room[6] , room[7]) )
    except Exception as e:
        errors.append([room , str(e)])
OUT = brailleFams, errors
# ----------------------------------------

# group: Output
watch = Watch(python_script)  # graph output
